# Grasshopper definition surface_path_planning.ghx (Grasshopper 1.0.7)

input_mesh = Mesh(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)
unload_modules = GhPythonScript(reload=Button())
# ---------- unload_modules: Python ----------
if reload:
    from compas_ghpython import unload_modules
    unload_modules('robotic_tufting')
    unload_modules('robotic_knitcrete')
# ---------- end unload_modules ----------
python = GhPythonScript(mesh=input_mesh)  # -> out, cmesh
# ---------- python: Python ----------
__author__ = "Gido"
__version__ = "2022.07.06"

import rhinoscriptsyntax as rs
from compas_rhino.geometry import RhinoMesh

rmesh = RhinoMesh.from_guid(mesh)
cmesh = rmesh.to_compas()
# ---------- end python ----------
data = Data(python.cmesh)
path_type = ValueList({"Lowest Axis Path": 1, "Lowest Axis Path Combined": 2, "Lowest Axis Path Priority": 3, "Lowest Axis Path Adjusted": 4, "Centroid Path": 5, "Boundary Path": 6, "Corners Path": 7, "Random Path Adjusted": 8, "Lowest Neighbors Path": 9}, selected="Lowest Axis Path")
orientation = ValueList({"X-axis": 0, "Y-axis": 1, "Z-axis": 2}, selected="X-axis")
image_input = BooleanToggle(False)
tool_path_planning = GhPythonScript(compute=Button(), path_type=path_type, orientation=orientation, image_input=image_input, mesh=data)  # -> points, edges, n, planes; inputs image_values: list
# ---------- tool_path_planning: Python ----------
import compas
from compas_rhino.geometry import RhinoMesh
from robotic_knitcrete.surface_path_planner import SurfacePathPlanner
from compas_ghpython.utilities import draw_network, draw_frame

planner = SurfacePathPlanner()
planner.set_quad_mesh(mesh)
planner.set_network_nodes()

if image_input == False:
    image_values = []

if path_type == 1:
    [network, n] = planner.lowest_axis_path(orientation, image_values)

points, edges = draw_network(network)

planes = []
for k in planner.network.path:
    frame = planner.network.node_attribute(key=k, name='frame')
    plane = draw_frame(frame)
    planes.append(plane)
# ---------- end tool_path_planning ----------
panel = Panel(tool_path_planning.n)
planes = Geometry(tool_path_planning.planes)
pt = Point(tool_path_planning.points)
path = Curve(tool_path_planning.edges)

# ----
# Simulation counter
knob = ControlKnob(Decimals=0, Limit=True, Maximum=2000, Minimum=0, Range=25, Value=0)
item = ListItem(List=planes, Index=knob, Wrap=True)

# ----
# Shotcrete Nozzle Tool (End-effector)
number_slider = Slider(0.2, range=0..1)
mesh = Mesh(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)
pt_2 = Point(Point(0, 0.55, 0.1065010352))
panel_2 = Panel("149")
Y = UnitY(Factor=number_slider)
move = Move(Geometry=pt_2, Motion=Y)  # -> Geometry, Transform
xz = XZPlane(Origin=move.Geometry)
cone = Cone(Base=xz, Radius=Slider(0.06, range=0..1), Length=number_slider)  # -> Cone, Tip
merge = Merge(Data1=mesh, Data2=cone.Cone)
orient = Orient(Geometry=merge, Source=xz, Target=item)  # -> Geometry, Transform

preview = CustomPreview(Geometry=orient.Geometry, Material=ColourSwatch(SwatchColor=RGB(227, 227, 227)))
preview_2 = CustomPreview(Geometry=input_mesh, Material=ColourSwatch(SwatchColor=RGB(143, 143, 143)))
